# Dynamo graph Areas from Rooms_script.dyn (Dynamo 2.6.2.15705)
# packages: Crumple 2022.5.27, archi-lab.net 2019.2.25

categories = Categories("OST_Rooms")
all_elements_of_category = ElementsOfCategory(Category=categories)
view_type = ViewTypesUi("AreaPlan")
getByType = archilab.Revit.Views.Views.GetByType(viewType=view_type)
areas_createbyrooms = Custom[© Areas.CreateByRooms](rooms=all_elements_of_category, view=getByType)  # package Crumple; Given a list of rooms, the node will create areas in the same position for an area plan view. The areas will have their name and number set to match their respective room.
