# Dynamo graph Reset Area Plan_script.dyn (Dynamo 2.6.2.15705)
# packages: Data-Shapes 2022.2.103, archi-lab.net 2019.2.25

code_block = CodeBlock { "Reset Area Plan"; "Proceed"; }
code_block_2 = CodeBlock { "Select Area Plan"; }
code_block_3 = CodeBlock { "AreaPlan"; }
getByType = archilab.Revit.Views.Views.GetByType(viewType=code_block_3)
dropdown_data = Custom[DropDown Data](InputName=code_block_2, Keys=getByType, Values=getByType)  # package Data-Shapes; Create data for DropDown input in UI.MultiInputForm ++ . Check out www.data-shapes.net for more infos.
code_block_4 = CodeBlock { "Wipe Area/Boundary?"; }
categories = Categories("OST_Areas")
categories_2 = Categories("OST_AreaSchemeLines")
list_create = List.Create(item0=categories, item1=categories_2)
dropdown_data_2 = Custom[DropDown Data](InputName=code_block_4, Keys=list_create, Values=list_create)
list_create_2 = List.Create(item0=dropdown_data, item1=dropdown_data_2)
boolean = BoolSelector(true)
multipleinputform = Custom[MultipleInputForm ++](Description_optional=code_block.out0, ButtonText_optional=code_block.out1, Inputs=list_create_2, Toggle=boolean)  # package Data-Shapes; Create a form with multiple inputs. see www.data-shapes.net for tutorials and infos!
code_block_5 = CodeBlock { 1; }
getItemAtIndex = List.GetItemAtIndex(list=multipleinputform.User_Inputs, index=code_block_5)
all_elements_of_category = ElementsOfCategory(Category=getItemAtIndex)

# group: Delete Elements
delete = archilab.Revit.Elements.Elements.Delete(element=all_elements_of_category)
