# Dynamo graph Remove Duplicate Walls_script.dyn (Dynamo 2.5.0.7460)
# packages: Data-Shapes 2022.2.103, BIM4Struc.Productivity 2.7.0, archi-lab.net 2019.2.25

current = Document.Current()
code_block = CodeBlock { "Wipe Duplicates"; "Proceed"; }
code_block_2 = CodeBlock { "Select Category"; }
categories_list = Custom[Categories list]()  # package Data-Shapes; Gives list of all Revit categories and a matching list of their names
boolean = BoolSelector(true)
dropdown_data = Custom[DropDown Data](InputName=code_block_2, Keys=categories_list.Category_name_s, Values=categories_list.Revit_Categories, Sorted_optional=boolean)  # package Data-Shapes; Create data for DropDown input in UI.MultiInputForm ++ . Check out www.data-shapes.net for more infos.
boolean_2 = BoolSelector(true)
multipleinputform = Custom[MultipleInputForm ++](Description_optional=code_block.out0, ButtonText_optional=code_block.out1, Inputs=dropdown_data, Toggle=boolean_2)  # package Data-Shapes; Create a form with multiple inputs. see www.data-shapes.net for tutorials and infos!
all_elements_of_category = ElementsOfCategory(Category=multipleinputform.User_Inputs)
flatten = List.Flatten(list=all_elements_of_category)
localCoordinateSystem = Custom[Element.LocalCoordinateSystem](element=all_elements_of_category)  # package BIM4Struc.Productivity; Get the insertion point and local axes of an element.
duplicateItemIndicies = archilab.Lists.Lists.DuplicateItemIndicies(list=localCoordinateSystem.InsertionPoint)
flatten_2 = List.Flatten(list=duplicateItemIndicies.duplicate)
getItemAtIndex = List.GetItemAtIndex(list=flatten, index=flatten_2)
delete = archilab.Revit.Elements.Elements.Delete(element=getItemAtIndex)
