# Dynamo graph Create Area Boundaries_script.dyn (Dynamo 2.5.0.7460)
# packages: archi-lab.net 2019.2.25, Orchid 206.3.1.8227, Crumple 2022.5.27, Clockwork for Dynamo 0.7.x 0.75.47, Data-Shapes 2022.2.103

# group: Collect all Rooms
categories = Categories("OST_Rooms")
all_elements_of_category = ElementsOfCategory(Category=categories)

# group: Filtering Conditions
code_block = CodeBlock { "equals"; }
code_block_2 = CodeBlock { "SDC_A_AREA TYPE"; }
code_block_3 = CodeBlock { ["NET"]; ["GROSS"]; }

o_filter_byparameter = Orchid.RevitProject.Elements.Filter.ByParameter(element=all_elements_of_category, ruleType=code_block, parameterName=code_block_2, value=code_block_3.out0)
condition = CodeBlock { false; }
clean = List.Clean(list=o_filter_byparameter, preserveIndices=condition)
code_block_4 = CodeBlock { "Create Area Boundaries"; "Proceed"; }
code_block_5 = CodeBlock { "Select Area Plan"; }

# group: Get Area Plan View
code_block_6 = CodeBlock { "AreaPlan"; }
getByType = archilab.Revit.Views.Views.GetByType(viewType=code_block_6)

dropdown_data = Custom[DropDown Data](InputName=code_block_5, Keys=getByType, Values=getByType)  # package Data-Shapes; Create data for DropDown input in UI.MultiInputForm ++ . Check out www.data-shapes.net for more infos.
code_block_7 = CodeBlock { true; }
multipleinputform = Custom[MultipleInputForm ++](Description_optional=code_block_4.out0, ButtonText_optional=code_block_4.out1, Inputs=dropdown_data, Toggle=code_block_7)  # package Data-Shapes; Create a form with multiple inputs. see www.data-shapes.net for tutorials and infos!
getParameterValueByName = Element.GetParameterValueByName(element=all_elements_of_category, parameterName=code_block_2)
contains = String.Contains(str=getParameterValueByName, searchFor=code_block_3.out0, lacing=Longest)
filterByBoolMask = List.FilterByBoolMask(list=all_elements_of_category, mask=contains)
rooms_boundaries = Custom[© Rooms.Boundaries](room=filterByBoolMask.in@L2)  # package Crumple; For a room or list of rooms, return all boundary (and internal) curves. The curves will be based on the currently nominated project room boundary settings.
o_filter_byparameter_2 = Orchid.RevitProject.Elements.Filter.ByParameter(element=all_elements_of_category, ruleType=code_block, parameterName=code_block_2, value=code_block_3.out1)
clean_2 = List.Clean(list=o_filter_byparameter_2, preserveIndices=condition)
getParameterValueByName_2 = Element.GetParameterValueByName(element=all_elements_of_category, parameterName=code_block_2)
contains_2 = String.Contains(str=getParameterValueByName_2, searchFor=code_block_3.out1, lacing=Longest)
filterByBoolMask_2 = List.FilterByBoolMask(list=all_elements_of_category, mask=contains_2)
boundaries = Custom[Room.Boundaries](Room=filterByBoolMask_2.in@L2)  # package archi-lab.net; This node returns all Room bounding curves and elements that generated them (walls, separation lines etc).
location = Custom[Element.Location](boundaries.Element)  # package Clockwork for Dynamo 0.7.x; Returns the location of an element as an XYZ (or if it's line-based the start and end point of the line), along with some booleans to help filtering the results. Use this for some element types (e.g. walls or lines) that do not work with the built-in Get Family Instance Location node.
code_block_8 = CodeBlock { 0.5; }
pointAtParameter = Curve.PointAtParameter(curve=location.Curves, param=code_block_8)
duplicateItemIndicies = archilab.Lists.Lists.DuplicateItemIndicies(list=pointAtParameter)
getItemAtIndex = List.GetItemAtIndex(list=location.Curves, index=duplicateItemIndicies.unique)

# group: Output
areas_createseparators = Custom[© Areas.CreateSeparators](view=multipleinputform.User_Inputs, curves=rooms_boundaries)  # package Crumple; Given a list of Dynamo curves, the node generates area boundary lines along them in the given view. For convenience of iterability, this node flattens the curve list by default.
areas_createseparators_2 = Custom[© Areas.CreateSeparators](view=multipleinputform.User_Inputs, curves=getItemAtIndex)
