# Dynamo custom node CableTray CurveNormal.dyf (Dynamo 2.6.1.8786)
# category: MEPover.Revit.Elements
# Returns the Curve Normal of the cable tray (the direction that always point to the upward open part of the cable tray)

CableTray = Input(CableTray: var[]..[])
python_script = Python(IN[0]=CableTray)
# ---------- python_script.python (36 lines) ----------
import clr

clr.AddReference("RevitServices")
import RevitServices
from RevitServices.Persistence import DocumentManager
from RevitServices.Transactions import TransactionManager
doc = DocumentManager.Instance.CurrentDBDocument

clr.AddReference("RevitAPI")
import Autodesk
from Autodesk.Revit.DB import *

clr.AddReference("RevitNodes")
import Revit
clr.ImportExtensions(Revit.Elements)
clr.ImportExtensions(Revit.GeometryConversion)

#Many thanks to Konrad K Sobon for his awesome ProcessList function!
def Unwrap(item):
	return UnwrapElement(item)

def ProcessList(_func, _list):
    return map( lambda x: ProcessList(_func, x) if type(x)==list else _func(x), _list )

if isinstance(IN[0], list):
	trays = ProcessList(Unwrap, IN[0])
else:
	trays = [Unwrap(IN[0])]
	
	
def getTrayNormal(tray):
	return tray.CurveNormal.ToVector()



OUT = ProcessList(getTrayNormal, trays)
# ----------------------------------------
Vector = Output(python_script)
