# Dynamo custom node Connector.SystemType.dyf (Dynamo 2.6.1.8786)
# category: MEPover.Revit.Connectors
# Returns the System Type of the connected system

connector = Input(connector: var[]..[])
python = Python(IN[0]=connector)
# ---------- python.python (43 lines) ----------
import clr

clr.AddReference("RevitServices")
import RevitServices
from RevitServices.Persistence import DocumentManager
from RevitServices.Transactions import TransactionManager
doc = DocumentManager.Instance.CurrentDBDocument

clr.AddReference("RevitAPI")
import Autodesk
from Autodesk.Revit.DB import *

clr.AddReference("RevitNodes")
import Revit
clr.ImportExtensions(Revit.Elements)
clr.ImportExtensions(Revit.GeometryConversion)

#Many thanks to Konrad K Sobon for his awesome ProcessList function!
def Unwrap(item):
	return UnwrapElement(item)

def ProcessList(_func, _list):
    return map( lambda x: ProcessList(_func, x) if type(x)==list else _func(x), _list )

if isinstance(IN[0], list):
	connectors = IN[0]
else:
	connectors = [IN[0]]
	
	
def getConnSysType(connector):
	systype = None
	try:
		sys = connector.MEPSystem
		systype = doc.GetElement(sys.GetTypeId())
	except:
		pass
	return systype

			
#Assign your output to the OUT variable.

OUT = ProcessList(getConnSysType, connectors)
# ----------------------------------------
SystemType = Output(python)
