# Dynamo custom node Duct.ConnectAirTerminalOnDuct.dyf (Dynamo 2.6.1.8786)
# category: MEPover.Revit.Elements
# This node will attempt to connect an air terminal onto a duct directly without creating a tee or tap.

Duct = Input(Duct: var[]..[])
AirTerminal = Input(AirTerminal: var[]..[])
python = Python(IN[0]=Duct, IN[1]=AirTerminal)
# ---------- python.python (51 lines) ----------
import clr

clr.AddReference("RevitServices")
import RevitServices
from RevitServices.Persistence import DocumentManager
from RevitServices.Transactions import TransactionManager
doc = DocumentManager.Instance.CurrentDBDocument

clr.AddReference("RevitAPI")
import Autodesk
from Autodesk.Revit.DB import *

clr.AddReference("RevitNodes")
import Revit
clr.ImportExtensions(Revit.Elements)
clr.ImportExtensions(Revit.GeometryConversion)

#Many thanks to Konrad K Sobon for his awesome ProcessList function!
def Unwrap(item):
	return UnwrapElement(item)
	
def ProcessList(_func, _list):
    return map( lambda x: ProcessList(_func, x) if type(x)==list else _func(x), _list )

def ProcessList2(_func, _list, _list2):
    return map( lambda x,y: ProcessList2(_func, x, y) if type(x)==list else _func(x,y), _list, _list2 )

if isinstance(IN[0], list):
	ducts = UnwrapElement(IN[0])
else:
	ducts = UnwrapElement([IN[0]])
	
if isinstance(IN[1], list):
	terminals = UnwrapElement(IN[1])
else:
	terminals = UnwrapElement([IN[1]])
	
	
def ConnectTo(duct, terminal):
	bool = False
	try:
		TransactionManager.Instance.EnsureInTransaction(doc)
		bool = Mechanical.MechanicalUtils.ConnectAirTerminalOnDuct(doc,terminal.Id,duct.Id)
		TransactionManager.Instance.TransactionTaskDone()
	except:
		pass
	return bool

			
#Assign your output to the OUT variable.
OUT = ProcessList2(ConnectTo, ducts, terminals)
# ----------------------------------------
Succes = Output(python)  # "Succes:bool"
