# Dynamo custom node Element.GetInsulation.dyf (Dynamo 2.6.1.8786)
# category: MEPover.Revit.Elements
# Will return the insulation of a pipe or duct

element = Input(element: var[]..[])
python_script = Python(IN[0]=element)
# ---------- python_script.python (33 lines) ----------
import clr

clr.AddReference("RevitServices")
import RevitServices
from RevitServices.Persistence import DocumentManager
from RevitServices.Transactions import TransactionManager
doc = DocumentManager.Instance.CurrentDBDocument

clr.AddReference("RevitAPI")
import Autodesk
from Autodesk.Revit.DB import *

clr.AddReference("RevitNodes")
import Revit
clr.ImportExtensions(Revit.Elements)
clr.ImportExtensions(Revit.GeometryConversion)

if isinstance(IN[0], list):
	pipes = UnwrapElement(IN[0])
else:
	pipes = [UnwrapElement(IN[0])]

listout = []

for pipe in pipes:
	try:
		insulation = InsulationLiningBase.GetInsulationIds(doc,pipe.Id)
		listout.append(doc.GetElement(insulation[0]))
	except:
		listout.append(None)


OUT = listout
# ----------------------------------------
Insulation = Output(python_script)
