# Dynamo custom node NewZone.dyf "Zone.NewZone" (Dynamo 2.6.1.8786)
# category: MEPover.Revit.RoomsAndSpaces
# Creates a new zone by level and phase

level = Input(level: var[]..[])
Phase = Input(Phase: var[]..[])
python = Python(IN[0]=level, IN[1]=Phase)
# ---------- python.python (46 lines) ----------
import clr

clr.AddReference("RevitServices")
import RevitServices
from RevitServices.Persistence import DocumentManager
from RevitServices.Transactions import TransactionManager
doc = DocumentManager.Instance.CurrentDBDocument

clr.AddReference("RevitAPI")
import Autodesk
from Autodesk.Revit.DB import *

clr.AddReference("RevitNodes")
import Revit
clr.ImportExtensions(Revit.Elements)
clr.ImportExtensions(Revit.GeometryConversion)


if isinstance(IN[0], list):
	levels = UnwrapElement(IN[0])
else:
	levels = [UnwrapElement(IN[0])]
	
if isinstance(IN[1], list):
	phases = UnwrapElement(IN[1])
else:
	phases = [UnwrapElement(IN[1])]
lp = len(phases)
	
	
def newZone(level, phase):
	try:
		TransactionManager.Instance.EnsureInTransaction(doc)
		zone = doc.Create.NewZone(level,phase)
		TransactionManager.Instance.TransactionTaskDone()
		return zone.ToDSType(False)
	except:
		return None

listout = []
for i, level in enumerate(levels):
	phase = phases[i%lp]
	listout.append(newZone(level,phase))
			
#Assign your output to the OUT variable.
OUT = listout
# ----------------------------------------
Zone = Output(python)
