# Dynamo custom node Pipe upstream components.dyf (Dynamo 2.6.1.8786)
# category: MEPover.Revit.Systems
# This node will try to return the connected elements in the upstream network. It will stop once it encounters an element twice or encounters a different system classification or cannot find a connector with an opposing direction.

element = Input(element: var[]..[])
python_script = Python(IN[0]=element)
# ---------- python_script.python (166 lines) ----------
import clr
import math

clr.AddReference("RevitServices")
import RevitServices
from RevitServices.Persistence import DocumentManager
from RevitServices.Transactions import TransactionManager
doc = DocumentManager.Instance.CurrentDBDocument

clr.AddReference("RevitAPI")
import Autodesk
from Autodesk.Revit.DB import *

clr.AddReference("RevitNodes")
import Revit
clr.ImportExtensions(Revit.Elements)
clr.ImportExtensions(Revit.GeometryConversion)
#The inputs to this node will be stored as a list in the IN variables.
if isinstance(IN[0], list):
	elements = UnwrapElement(IN[0])
else:
	elements = [UnwrapElement(IN[0])]
	
def getSize(x):
	try:
		conns = x.ConnectorManager.Connectors
	except:
		conns = x.MEPModel.ConnectorManager.Connectors
	maxsize = 0
	for c in conns:
		if c.Shape != ConnectorProfileType.Round:
			continue
		else:
			startsize = c.Radius * 2
		if startsize > maxsize:
			maxsize = startsize
	return maxsize
	
factor = 99999

def nextElement(elem,sys):
	sysname = next.get_Parameter(BuiltInParameter.RBS_SYSTEM_CLASSIFICATION_PARAM).AsString()
	for s in sysname.split(","):
		if s in sys.split(","):
			break
	else:
		return 4
	if "Return" in sysname or "Sanitary" in sysname:
		direction = FlowDirectionType.In
	else:
		direction = FlowDirectionType.Out
	try:
		connectors = elem.ConnectorManager.Connectors
		for conn in connectors:
			if conn.Domain != Domain.DomainPiping:
				continue
			elif conn.Direction == direction:
				continue
			else:
				endconn = conn
		for c in endconn.AllRefs:
			if c.Owner.Id.Equals(elem.Id):
				continue
			elif c.Owner.GetType() == Mechanical.MechanicalSystem or c.Owner.GetType() == Plumbing.PipingSystem:
				return 0
			else:
				newelem = c.Owner
		return newelem
	except AttributeError:
		connectors = elem.MEPModel.ConnectorManager.Connectors
		if connectors.Size == 1:
			for conn in connectors:
				if conn.Domain != Domain.DomainPiping:
					continue
				endconn = conn
			if endconn.AllRefs.Size == 1:
				for c in endconn.AllRefs:
					if c.Owner.GetType() == Mechanical.MechanicalSystem or c.Owner.GetType() == Plumbing.PipingSystem:
						return 1
			for c in endconn.AllRefs:
				if c.Owner.Id.Equals(elem.Id):
					continue
				elif c.Owner.GetType() == Mechanical.MechanicalSystem or c.Owner.GetType() == Plumbing.PipingSystem:
					continue
				else:
					newelem = c.Owner
			return newelem
		elif connectors.Size == 2:
			for conn in connectors:
				if conn.Domain != Domain.DomainPiping:
					continue
				if conn.Direction == direction:
					continue
				else:
					endconn = conn
			if endconn.AllRefs.Size == 1:
				for c in endconn.AllRefs:
					if c.Owner.GetType() == Mechanical.MechanicalSystem or c.Owner.GetType() == Plumbing.PipingSystem:
						return 2
			for c in endconn.AllRefs:
				if c.Owner.Id.Equals(elem.Id):
					continue
				elif c.Owner.GetType() == Mechanical.MechanicalSystem or c.Owner.GetType() == Plumbing.PipingSystem:
					continue
				else:
					newelem = c.Owner
			return newelem
		else:
			for conn in connectors:
				if conn.Domain != Domain.DomainPiping:
					continue
				if conn.Direction != direction:
					endconn = conn
			if endconn.AllRefs.Size == 1:
				for c in endconn.AllRefs:
					if c.Owner.GetType() == Mechanical.MechanicalSystem or c.Owner.GetType() == Plumbing.PipingSystem:
						return 3
			for c in endconn.AllRefs:
				if c.Owner.Id.Equals(elem.Id):
					continue
				elif c.Owner.GetType() == Mechanical.MechanicalSystem or c.Owner.GetType() == Plumbing.PipingSystem:
					continue
				else:
					newelem = c.Owner
			return newelem

result = []
endlist = []
for j,x in enumerate(elements):
	listout = []
	ids = []
	sysclass = x.get_Parameter(BuiltInParameter.RBS_SYSTEM_CLASSIFICATION_PARAM).AsString()
	startsize = getSize(x)
	next = x
	i = 0
	while True:
		if i > 1000:
			result.append(next.Id.ToString() + ": end of loop")
			break
		try:
			next = nextElement(next,sysclass)
			i += 1
		except Exception as e:
			result.append(next.Id.ToString() + ": probably a direction error")
			break		
		if isinstance(next, int):
			result.append(next.ToString() + ": open end or different system classification")
			break
		if next.Id in ids:
			result.append(next.Id.ToString() + ": double element")
			break
		i += 1
		nextsize = getSize(next)
		if nextsize > startsize * factor:
			result.append(next.Id.ToString() + ": size end")
			break
		ids.append(next.Id)
		listout.append(next)
	endlist.append(listout)


#Assign your output to the OUT variable.
if len(endlist) == 1:
	OUT = listout, result
else:
	OUT = endlist, result
# ----------------------------------------
code_block = CodeBlock(x=python_script) { x[0]; }
Elements = Output(code_block)
