# Dynamo custom node Pipe.ByLines.dyf (Dynamo 2.6.1.8786)
# category: MEPover.Revit.Elements
# Creates a pipe by Line, PipeType, SystemType, Level and Diameter

Lines = Input(Lines: var[]..[])
PipeType = Input(PipeType: var[]..[])
SystemType = Input(SystemType: var[]..[])
level = Input(level: var[]..[])
Diameter = Input(Diameter: var[]..[])
python_script = Python(IN[0]=Lines, IN[1]=PipeType, IN[2]=SystemType, IN[3]=level, IN[4]=Diameter)
# ---------- python_script.python (69 lines) ----------
import clr

clr.AddReference("RevitServices")
import RevitServices
from RevitServices.Persistence import DocumentManager
from RevitServices.Transactions import TransactionManager
doc = DocumentManager.Instance.CurrentDBDocument

clr.AddReference("RevitAPI")
import Autodesk
from Autodesk.Revit.DB import *

clr.AddReference("RevitNodes")
import Revit
clr.ImportExtensions(Revit.Elements)
clr.ImportExtensions(Revit.GeometryConversion)


if isinstance(IN[0], list):
	lines = IN[0]
else:
	lines = [IN[0]]
FirstPoint = [x.StartPoint for x in lines]
SecondPoint = [x.EndPoint for x in lines]
if isinstance(IN[1], list):
	pipetype = UnwrapElement(IN[1])
else:
	pipetype = [UnwrapElement(IN[1])]
ptl = len(pipetype)

if isinstance(IN[2], list):
	systemtype = UnwrapElement(IN[2])
else:
	systemtype = [UnwrapElement(IN[2])]
stl = len(systemtype)
if isinstance(IN[3], list):
	level = UnwrapElement(IN[3])
else:
	level = [UnwrapElement(IN[3])]
ll = len(level)
if isinstance(IN[4], list):
	diameter = IN[4]
else:
	diameter = [IN[4]]
dl = len(diameter)

elements = []

TransactionManager.Instance.EnsureInTransaction(doc)
for i,x in enumerate(FirstPoint):
	try:
		levelid = level[i%ll].Id
		systypeid = systemtype[i%stl].Id
		pipetypeid = pipetype[i%ptl].Id
		diam = diameter[i%dl]
		
		pipe = Autodesk.Revit.DB.Plumbing.Pipe.Create(doc,systypeid,pipetypeid,levelid,x.ToXyz(),SecondPoint[i].ToXyz())
		
		param = pipe.get_Parameter(BuiltInParameter.RBS_PIPE_DIAMETER_PARAM)
		param.SetValueString(diam.ToString())
	
		elements.append(pipe.ToDSType(False))	
	except:
		elements.append(None)

TransactionManager.Instance.TransactionTaskDone()


OUT = elements
# ----------------------------------------
Pipes = Output(python_script)
