# Dynamo custom node SpaceCoordination Manager.dyf (Dynamo 2.6.1.8786)
# category: MEPover.Revit.RoomsAndSpaces
# This node will align all spaces in the model to the rooms from a linked model. It will delete spaces that can't find a corresponding room number, move spaces to rooms with the same number and create new spaces for rooms with new room numbers.

LinkDoc = Input(LinkDoc: var[]..[])
Phase = Input(Phase: var[]..[])
python_script = Python(IN[0]=LinkDoc, IN[1]=Phase)
# ---------- python_script.python (149 lines) ----------
import clr
import math

clr.AddReference("RevitServices")
import RevitServices
from RevitServices.Persistence import DocumentManager
from RevitServices.Transactions import TransactionManager
doc = DocumentManager.Instance.CurrentDBDocument

clr.AddReference("RevitAPI")
import Autodesk
from Autodesk.Revit.DB import *

clr.AddReference("RevitNodes")
import Revit
clr.ImportExtensions(Revit.Elements)
clr.ImportExtensions(Revit.GeometryConversion)

from System.Collections.Generic import List

linkdoc = IN[0]
phase = UnwrapElement(IN[1])

collector = FilteredElementCollector(doc)
levels = collector.OfClass(Level).ToElements()
	
leveldict2 = {}
for level in levels:
	leveldict2[math.ceil((level.Elevation+0.5)*100)/100] = level
	
collector2 = FilteredElementCollector(doc)
spaces = collector2.OfCategory(BuiltInCategory.OST_MEPSpaces).ToElements()

collector3 = FilteredElementCollector(linkdoc)
rooms = collector3.OfCategory(BuiltInCategory.OST_Rooms).ToElements()

spacedict = {}
for x in spaces:
	spacedict[x.Number] = x

roomdict = {}
for x in rooms:
	if x.Location != None:
		roomdict[x.Number] = x


spacenumbers = [x.Number for x in spaces]
roomnumbers = [x.Number for x in rooms if x.Location != None]
spaceset = set(spacenumbers)
roomset = set(roomnumbers)

replace = spaceset.intersection(roomset)
delete = spaceset.difference(roomset)
newrooms = roomset.difference(spaceset)

TransactionManager.Instance.EnsureInTransaction(doc)
for x in delete:
	space = spacedict[x]
	doc.Delete(space.Id)
TransactionManager.Instance.TransactionTaskDone()

newspaces = []
remains = []
moved = []
newlocations = []

newrooms2 = []

TransactionManager.Instance.EnsureInTransaction(doc)
for x in newrooms:
	room = roomdict[x]
	roomelev = math.ceil((room.Level.Elevation+0.5)*100)/100
	level = leveldict2[roomelev]
	
	try:
		newrooms2.append(room)
		loc = room.Location.Point
		newspace = doc.Create.NewSpace(level,phase,UV(loc.X,loc.Y))
		newspaces.append(newspace)
	except:
		newspaces.append("failed new space creation for room: "+ x)
TransactionManager.Instance.TransactionTaskDone()



options = CopyPasteOptions()
elementlist = List[ElementId]()
	
TransactionManager.Instance.EnsureInTransaction(doc)
for x in replace:
	space = spacedict[x]
	number = space.Number
	roomnumber = space.get_Parameter(BuiltInParameter.SPACE_ASSOC_ROOM_NUMBER).AsString()
	room = roomdict[x]
	posroom = room.Location.Point
	posspace = space.Location.Point
	
	if number != roomnumber:
		newlocations.append(number)
		if round(space.Level.Elevation) != round(room.Level.Elevation):
		#if room moved to a different level: copy space to that level and delete the old one.
			#copy space to room's level
			elementlist.Add(space.Id)
			OffsetZ = (math.ceil((space.Level.Elevation+0.5)*100)/100) - (math.ceil(room.Level.Elevation*100)/100)*-1
			OffsetX = (posspace.X - posroom.X)*-1
			OffsetY = (posspace.Y - posroom.Y)*-1
			direction = XYZ(OffsetX,OffsetY,OffsetZ)
			trans = Transform.CreateTranslation(direction)
			newspace = ElementTransformUtils.CopyElements(doc,elementlist,doc,trans,options)
			elementlist.Clear()

			#delete space
			doc.Delete(space.Id)
		else:
		#otherwise just move it to the new location on the same level
			newloc = XYZ(posroom.X,posroom.Y,posroom.Z)
			try:
				space.Location.Point = newloc
			except:
				pass
	else:
		if posspace.DistanceTo(posroom) < 10/304.8:
			remains.append(number)
		else:
			OffsetX = (posspace.X - posroom.X)*-1
			OffsetY = (posspace.Y - posroom.Y)*-1
			direction = XYZ(OffsetX,OffsetY,0)
			ElementTransformUtils.MoveElement(doc,space.Id,direction)
		
			#newloc = XYZ(posroom.X,posroom.Y,posroom.Z)
			#posspace = newloc
			moved.append(number)
			elementlist.Clear()
TransactionManager.Instance.TransactionTaskDone()

newspaces2 = []
TransactionManager.Instance.EnsureInTransaction(doc)
for space,room in zip(newspaces,newrooms2):
	try:
		space.LimitOffset = room.LimitOffset
	except:
		pass
	space.Number = room.Number

	newspaces2.append(space.ToDSType(False))
TransactionManager.Instance.TransactionTaskDone()

#Assign your output to the OUT variable.
OUT = delete,newspaces2,newlocations,moved,remains
# ----------------------------------------
code_block = CodeBlock(x=python_script) { x[0]; }
Deleted_Spaces = Output(code_block)
code_block_2 = CodeBlock(x=python_script) { x[1]; }
New_Spaces = Output(code_block_2)
code_block_3 = CodeBlock(x=python_script) { x[2]; }
Moved_to_new_location = Output(code_block_3)
code_block_4 = CodeBlock(x=python_script) { x[3]; }
Moved_in_same_location = Output(code_block_4)
code_block_5 = CodeBlock(x=python_script) { x[4]; }
No_changes = Output(code_block_5)
