# Dynamo custom node Tag Get View.dyf (Dynamo 2.6.1.8786)
# category: MEPover.Revit.Tags
# Return the view on which the tag is placed

tags = Input(tags: var[]..[])
python_script = Python(IN[0]=tags)
# ---------- python_script.python (21 lines) ----------
import clr

clr.AddReference("RevitServices")
import RevitServices
from RevitServices.Persistence import DocumentManager
doc =  DocumentManager.Instance.CurrentDBDocument

if isinstance(IN[0], list):
	tags = UnwrapElement(IN[0])
else:
	tags = [UnwrapElement(IN[0])]

listout = []

for x in tags:
	Id = x.OwnerViewId
	view = doc.GetElement(Id)
	listout.append(view)


OUT = listout
# ----------------------------------------
views = Output(python_script)
