# Dynamo custom node All elements at Level.dyf (Dynamo 2.6.1.8786)
# category: MEPover.Revit.Elements
# The same as the out of the box node, but this one also returns more type of families (e.g. System families)

level = Input(level: var[]..[])
IncludeSpatialElements = Input(IncludeSpatialElements: bool = false)
python_script = Python(IN[0]=level, IN[1]=IncludeSpatialElements)
# ---------- python_script.python (58 lines) ----------
import clr
import System

clr.AddReference("RevitServices")
import RevitServices
from RevitServices.Persistence import DocumentManager
from RevitServices.Transactions import TransactionManager
doc = DocumentManager.Instance.CurrentDBDocument

clr.AddReference("RevitAPI")
import Autodesk
from Autodesk.Revit.DB import *

clr.AddReference("RevitNodes")
import Revit
clr.ImportExtensions(Revit.Elements)
clr.ImportExtensions(Revit.GeometryConversion)

from System.Collections.Generic import List

level = UnwrapElement(IN[0])
spatials = IN[1]
levelId = level.Id


evaluator = FilterNumericEquals()
filterlist = List[ElementFilter]()

levelnames = ["Base Level","Reference Level", "Level"]
grouplevel = BuiltInParameter.GROUP_LEVEL
zonelevel = BuiltInParameter.ZONE_LEVEL_ID
roomlevel = BuiltInParameter.ROOM_LEVEL_ID
exclusions1 = [zonelevel,roomlevel]
exclusion2 = grouplevel
bips = System.Enum.GetValues(BuiltInParameter)

test = []
for bip in bips:
	if spatials == False and bip in exclusions1:
		continue
	if bip == exclusion2:
		continue
	try:
		paramname = LabelUtils.GetLabelFor(bip)
	except:
		continue
	if paramname in levelnames:
		provider = ParameterValueProvider(ElementId(bip))
		rule = FilterElementIdRule(provider,evaluator,levelId)
		filterlist.Add(ElementParameterFilter(rule))


OrFilter = LogicalOrFilter(filterlist)
collector2 = FilteredElementCollector(doc)
collector2.WherePasses(OrFilter)

elements = collector2.ToElements()
OUT = [x for x in elements if x.GetType() != Element]
# ----------------------------------------
Elements = Output(python_script)
