# Dynamo custom node All_(Linked)_Elements_In_View.dyf (Dynamo 2.13.1.3887)
# category: MEPover.Revit.Elements
# This node will return a dictionary with all visible element per document from the given view, including elements from linked files.

view = Input(view: Revit.Elements.Views.View)
python_script = Python(IN[0]=view)  # IronPython2
# ---------- python_script.python (236 lines) ----------
import clr

clr.AddReference("RevitServices")
import RevitServices
from RevitServices.Persistence import DocumentManager
from RevitServices.Transactions import TransactionManager
doc = DocumentManager.Instance.CurrentDBDocument
uidoc = DocumentManager.Instance.CurrentUIApplication.ActiveUIDocument

clr.AddReference("RevitAPI")
import Autodesk
from Autodesk.Revit.DB import *

clr.AddReference("RevitNodes")
import Revit
clr.ImportExtensions(Revit.Elements)
clr.ImportExtensions(Revit.GeometryConversion)

from System.Collections.Generic import List

def remove_duplicates(d):
    for key, objects in d.items():
        seen = {}
        new_objects = []
        for obj in objects:
            if obj == None:
                continue
            if obj.GetType() == Autodesk.Revit.DB.Element:
            	continue
            if obj.Id not in seen:
                seen[obj.Id] = obj
                new_objects.append(obj)
        d[key] = new_objects
        
		

class ElementCollector:
    def __init__(self, uidoc, view):
        self._uiDocument = uidoc
        self._app = uidoc.Application.Application
        self._parentDocument = uidoc.Document
        self._activeView = self._parentDocument.ActiveView
        self._view = view
        
        
    def GetVisibleElements(self):
    	viewtype = self._view.ViewType
    	if viewtype == ViewType.ThreeD:
    		self.context = VisibleElementContext(self._parentDocument)
        elif viewtype == ViewType.FloorPlan or viewtype == ViewType.Section or viewtype == ViewType.Elevation or viewtype == ViewType.CeilingPlan or viewtype == ViewType.AreaPlan or viewtype == ViewType.EngineeringPlan:
        	self.context = VisibleElementContext2D(self._parentDocument)
        	
        exp = CustomExporter(self._parentDocument, self.context)
        views = List[ElementId]([self._view.Id])
        exp.Export(views)
        
        outmap = self.context.DocMap
        remove_duplicates(outmap)
        		       		
        return outmap
        

        


class VisibleElementContext2D(IExportContext2D):
    def __init__(self, doc):
        self.ParentDocument = doc
        self.CurrentDocument = doc
        self.Documents = [doc]
        self.Elements = []
        self.ElementIds = []
        self.DocMap = {}
        self.DocMap[self.CurrentDocument.Title] = []

    def Finish(self):
        pass

    def IsCanceled(self):
        return False

    def OnCurve(self, node):
        return RenderNodeAction.Skip

    def OnElementBegin(self, elementId):
        return RenderNodeAction.Skip

    def OnElementBegin2D(self, node):
        elem = self.CurrentDocument.GetElement(node.ElementId)
        self.Elements.append(elem)
        self.DocMap[self.CurrentDocument.Title].append(elem)
        return RenderNodeAction.Proceed

    def OnElementEnd(self, elementId):
        pass

    def OnElementEnd2D(self, node):
        pass

    def OnFaceBegin(self, node):
        return RenderNodeAction.Skip

    def OnFaceEdge2D(self, node):
        return RenderNodeAction.Skip

    def OnFaceEnd(self, node):
        pass

    def OnFaceSilhouette2D(self, node):
        return RenderNodeAction.Skip

    def OnInstanceBegin(self, node):
        return RenderNodeAction.Proceed

    def OnInstanceEnd(self, node):
        pass

    def OnLight(self, node):
        pass

    def OnLineSegment(self, segment):
        pass

    def OnLinkBegin(self, node):
        doc = node.GetDocument()
        self.Documents.append(doc)
        self.CurrentDocument = doc
        if self.CurrentDocument.Title not in self.DocMap:
        	self.DocMap[self.CurrentDocument.Title] = []
        return RenderNodeAction.Proceed

    def OnLinkEnd(self, node):
        self.CurrentDocument = self.ParentDocument

    def OnMaterial(self, node):
        pass

    def OnPolyline(self, node):
        return RenderNodeAction.Skip

    def OnPolylineSegments(self, segments):
        pass

    def OnPolymesh(self, node):
        pass

    def OnRPC(self, node):
        pass

    def OnText(self, node):
        pass

    def OnViewBegin(self, node):
        return RenderNodeAction.Proceed

    def OnViewEnd(self, elementId):
        pass

    def Start(self):
        return True
        
class VisibleElementContext(IExportContext):
    def __init__(self, doc):
        self.ParentDocument = doc
        self.CurrentDocument = doc
        self.Documents = [doc]
        self.Elements = []
        self.ElementIds = []
        self.DocMap = {}
        self.DocMap[self.CurrentDocument.Title] = []

    def Start(self):
        return True

    def Finish(self):
        pass

    def IsCanceled(self):
        return False

    def OnViewBegin(self, node):
        return RenderNodeAction.Proceed

    def OnViewEnd(self, elementId):
        pass

    def OnElementBegin(self, elementId):
        self.ElementIds.append(elementId)
        elem = self.CurrentDocument.GetElement(elementId)
        self.Elements.append(elem)
        self.DocMap[self.CurrentDocument.Title].append(elem)
        return RenderNodeAction.Proceed

    def OnElementEnd(self, elementId):
        pass

    def OnInstanceBegin(self, node):
        return RenderNodeAction.Proceed

    def OnInstanceEnd(self, node):
        pass

    def OnLinkBegin(self, node):
        doc = node.GetDocument()
        self.Documents.append(doc)
        self.CurrentDocument = doc
        if self.CurrentDocument.Title not in self.DocMap:
        	self.DocMap[self.CurrentDocument.Title] = []
        return RenderNodeAction.Proceed

    def OnLinkEnd(self, node):
        self.CurrentDocument = self.ParentDocument

    def OnFaceBegin(self, node):
        return RenderNodeAction.Skip

    def OnFaceEnd(self, node):
        pass

    def OnRPC(self, node):
        pass

    def OnLight(self, node):
        pass

    def OnMaterial(self, node):
        pass

    def OnPolymesh(self, node):
        pass

view = UnwrapElement(IN[0])
collector = ElementCollector(uidoc, view)
elements = collector.GetVisibleElements()

OUT =  elements
# ----------------------------------------
components = DesignScript.Builtin.Dictionary.Components(dictionary=python_script)
documents = Output(components.keys)
elements = Output(components.values)
