# Dynamo custom node CableTray SetCurveNormal.dyf (Dynamo 2.0.3.8810)
# category: MEPover.Revit.Elements
# sets the curve normal of the cable tray, allowing you to rotate the cable tray along its own axis.

cabletray = Input(cabletray: var[]..[])
vector = Input(vector: var[]..[])
python_script = Python(IN[0]=cabletray, IN[1]=vector)
# ---------- python_script.python (37 lines) ----------
import clr

clr.AddReference("RevitServices")
import RevitServices
from RevitServices.Persistence import DocumentManager
from RevitServices.Transactions import TransactionManager
doc = DocumentManager.Instance.CurrentDBDocument

clr.AddReference("RevitAPI")
import Autodesk
from Autodesk.Revit.DB import *

clr.AddReference("RevitNodes")
import Revit
clr.ImportExtensions(Revit.Elements)
clr.ImportExtensions(Revit.GeometryConversion)

if isinstance(IN[0], list):
	trays = UnwrapElement(IN[0])
else:
	trays = [UnwrapElement(IN[0])]
	
if isinstance(IN[1], list):
	vectors = IN[1]
else:
	vectors = [IN[1]]
	
	
def setTrayNormal(tray,vector):
	tray.CurveNormal = vector.ToXyz()
	return tray.ToDSType(True)

listout = []
for tray,vector in zip(trays,vectors):
	listout.append(setTrayNormal(tray,vector))

OUT = listout
# ----------------------------------------
cabletray_2 = Output(python_script)  # "cabletray"
