# Dynamo custom node CableTray.ByLines.dyf (Dynamo 2.6.1.8786)
# category: MEPover.Revit.Elements
# Creates CableTray by Lines, CableTrayType, Level, Width and Height

Lines = Input(Lines: var[]..[])
CableTrayType = Input(CableTrayType: var[]..[])
level = Input(level: var[]..[])
Width = Input(Width: var[]..[])
Height = Input(Height: var[]..[])
python_script = Python(IN[0]=Lines, IN[1]=CableTrayType, IN[2]=level, IN[3]=Width, IN[4]=Height)
# ---------- python_script.python (106 lines) ----------
import clr

clr.AddReference("RevitServices")
import RevitServices
from RevitServices.Persistence import DocumentManager
from RevitServices.Transactions import TransactionManager
doc = DocumentManager.Instance.CurrentDBDocument

clr.AddReference("RevitAPI")
import Autodesk
from Autodesk.Revit.DB import *

clr.AddReference("RevitNodes")
import Revit
clr.ImportExtensions(Revit.Elements)
clr.ImportExtensions(Revit.GeometryConversion)

toggle = ""

if isinstance(IN[0], list):
	lines = IN[0]
else:
	lines = [IN[0]]
FirstPoint = [x.StartPoint for x in lines]
SecondPoint = [x.EndPoint for x in lines]
cabletraytype = UnwrapElement(IN[1])
if isinstance(IN[2], list):
	level = UnwrapElement(IN[2])
	toggle += "0"
else:
	level = [UnwrapElement(IN[2])]
if isinstance(IN[3], list):
	width = IN[3]
	toggle += "1"
else:
	width = [IN[3]]
if isinstance(IN[4], list):
	height = IN[4]
	toggle += "1"
else:
	height = [IN[4]]

elements = []

if toggle == "":
	TransactionManager.Instance.EnsureInTransaction(doc)
	for i,x in enumerate(FirstPoint):
		tray = Autodesk.Revit.DB.Electrical.CableTray.Create(doc,cabletraytype.Id,FirstPoint[i].ToXyz(),SecondPoint[i].ToXyz(),level[0].Id)
		
		param = tray.get_Parameter(BuiltInParameter.RBS_CABLETRAY_WIDTH_PARAM)
		param.SetValueString(width[0].ToString())
		
		param2 = tray.get_Parameter(BuiltInParameter.RBS_CABLETRAY_HEIGHT_PARAM)
		param2.SetValueString(height[0].ToString())

		elements.append(tray.ToDSType(False))

	TransactionManager.Instance.TransactionTaskDone()
	
elif toggle == "0":
	TransactionManager.Instance.EnsureInTransaction(doc)
	for i,x in enumerate(FirstPoint):
		tray = Autodesk.Revit.DB.Electrical.CableTray.Create(doc,cabletraytype.Id,FirstPoint[i].ToXyz(),SecondPoint[i].ToXyz(),level[i].Id)
		
		param = tray.get_Parameter(BuiltInParameter.RBS_CABLETRAY_WIDTH_PARAM)
		param.SetValueString(width[0].ToString())
		
		param2 = tray.get_Parameter(BuiltInParameter.RBS_CABLETRAY_HEIGHT_PARAM)
		param2.SetValueString(height[0].ToString())

		elements.append(tray.ToDSType(False))

	TransactionManager.Instance.TransactionTaskDone()
	
elif toggle == "11":
	TransactionManager.Instance.EnsureInTransaction(doc)
	for i,x in enumerate(FirstPoint):
		tray = Autodesk.Revit.DB.Electrical.CableTray.Create(doc,cabletraytype.Id,FirstPoint[i].ToXyz(),SecondPoint[i].ToXyz(),level[0].Id)
		
		param = tray.get_Parameter(BuiltInParameter.RBS_CABLETRAY_WIDTH_PARAM)
		param.SetValueString(width[i].ToString())
		
		param2 = tray.get_Parameter(BuiltInParameter.RBS_CABLETRAY_HEIGHT_PARAM)
		param2.SetValueString(height[i].ToString())

		elements.append(tray.ToDSType(False))

	TransactionManager.Instance.TransactionTaskDone()
	
elif toggle == "011":
	TransactionManager.Instance.EnsureInTransaction(doc)
	for i,x in enumerate(FirstPoint):
		tray = Autodesk.Revit.DB.Electrical.CableTray.Create(doc,cabletraytype.Id,FirstPoint[i].ToXyz(),SecondPoint[i].ToXyz(),level[i].Id)
		
		param = tray.get_Parameter(BuiltInParameter.RBS_CABLETRAY_WIDTH_PARAM)
		param.SetValueString(width[i].ToString())
		
		param2 = tray.get_Parameter(BuiltInParameter.RBS_CABLETRAY_HEIGHT_PARAM)
		param2.SetValueString(height[i].ToString())

		elements.append(tray.ToDSType(False))

	TransactionManager.Instance.TransactionTaskDone()


OUT = elements
# ----------------------------------------
Cable_Trays = Output(python_script)
