# Dynamo custom node Collector.FilterStringEndsWith LinkDoc.dyf (Dynamo 2.6.1.8786)
# category: MEPover.Revit.Parameters
# Returns the most common elements (host objects and family instances) from a linked model by supplying a parameter and the value to search for. Of course the parameter needs to be of type 'string' to work.

parameter = Input(parameter: string)
SearchValue = Input(SearchValue: string)
boolean = BoolSelector(false)  # graph input
LinkDoc = Input(LinkDoc: var[]..[])
python_filterstringendswith = Python(IN[0]=parameter, IN[1]=SearchValue, IN[2]=boolean, IN[3]=LinkDoc)
# ---------- python_filterstringendswith.python (128 lines) ----------
import clr
import System

clr.AddReference("RevitServices")
import RevitServices
from RevitServices.Persistence import DocumentManager
from RevitServices.Transactions import TransactionManager
doc = DocumentManager.Instance.CurrentDBDocument
clr.AddReference("RevitAPI")
import Autodesk
from Autodesk.Revit.DB import *

clr.AddReference("RevitNodes")
import Revit
clr.ImportExtensions(Revit.Elements)
clr.ImportExtensions(Revit.GeometryConversion)

from System.Collections.Generic import List
string = IN[1]
case = IN[2]
search = IN[0]
doc = IN[3]

bips = System.Enum.GetValues(BuiltInParameter)

bm = doc.ParameterBindings
bmlist = bm.ForwardIterator()
paramId = None
testout = []
while bmlist.MoveNext():
	binddef = bmlist.Key
	testout.append(binddef.Name)
	if binddef.Name == search:
		paramId = binddef.Id
		break

param = None
if paramId == None:
	biplist = []
	for bip in bips:
		try:
			name = LabelUtils.GetLabelFor(bip)
		except:
			continue
		if name == search:
			biplist.append(bip)

sharedparamrule = SharedParameterApplicableRule(search)

evaluator = FilterStringEndsWith()

parameter = None
if paramId == None and len(biplist) == 0:
	coll = FilteredElementCollector(doc)
	sharedparams = coll.OfClass(ParameterElement)
	
	for param in sharedparams:
		name = param.GetDefinition().Name
		if name == search:
			parameter = param
	
	if parameter != None:
		ruleslist = List[FilterRule]()
		provider = ParameterValueProvider(parameter.Id)
		filterrule = FilterStringRule(provider, evaluator, string, case)
		ruleslist.Add(filterrule)
		ruleslist.Add(sharedparamrule)
		paramFilter = ElementParameterFilter(ruleslist)
		collector = FilteredElementCollector(doc)
		collector.OfClass(FamilyInstance).WherePasses(paramFilter)
		
		collector2 = FilteredElementCollector(doc)
		collector2.OfClass(HostObject).WherePasses(paramFilter)
		collector2.UnionWith(collector)
elif paramId == None:
	if len(biplist) == 1:
		provider = ParameterValueProvider(ElementId(biplist[0]))
		filterrule = FilterStringRule(provider, evaluator, string, case)
		paramFilter = ElementParameterFilter(filterrule)
		collector = FilteredElementCollector(doc)
		collector.OfClass(FamilyInstance).WherePasses(paramFilter)
		
		collector2 = FilteredElementCollector(doc)
		collector2.OfClass(HostObject).WherePasses(paramFilter)
		collector2.UnionWith(collector)
	else:
		provider = ParameterValueProvider(ElementId(biplist[0]))
		filterrule = FilterStringRule(provider, evaluator, string, case)
		paramFilter = ElementParameterFilter(filterrule)
		collector = FilteredElementCollector(doc)
		collector.OfClass(FamilyInstance).WherePasses(paramFilter)
		
		collector2 = FilteredElementCollector(doc)
		collector2.OfClass(HostObject).WherePasses(paramFilter)
		collector2.UnionWith(collector)
		for i,param in enumerate(biplist):
			if i == 0:
				continue
			provider = ParameterValueProvider(ElementId(param))
			filterrule = FilterStringRule(provider, evaluator, string, case)
			paramFilter = ElementParameterFilter(filterrule)
			tempcollector1 = FilteredElementCollector(doc)
			tempcollector1.OfClass(FamilyInstance).WherePasses(paramFilter)
			tempcollector2 = FilteredElementCollector(doc)
			tempcollector2.OfClass(HostObject).WherePasses(paramFilter)
			tempcollector2.UnionWith(tempcollector1)
			collector2.UnionWith(tempcollector2)
	
else:
	ruleslist = List[FilterRule]()
	provider = ParameterValueProvider(paramId)
	filterrule = FilterStringRule(provider, evaluator, string, case)
	ruleslist.Add(filterrule)
	ruleslist.Add(sharedparamrule)
	paramFilter = ElementParameterFilter(ruleslist)
	collector = FilteredElementCollector(doc)
	collector.OfClass(FamilyInstance).WherePasses(paramFilter)
	
	collector2 = FilteredElementCollector(doc)
	collector2.OfClass(HostObject).WherePasses(paramFilter)
	collector2.UnionWith(collector)


if parameter == None and paramId == None and len(biplist) == 0:
	OUT = "Does not work with non-shared family parameters"
else:
	elements = collector2.ToElements()
	OUT = elements
# ----------------------------------------
Elements = Output(python_filterstringendswith)
