# Dynamo custom node DuctRound.ByLines.dyf (Dynamo 2.6.1.8786)
# category: MEPover.Revit.Elements
# Create round Ducts by Lines, DuctType, SystemType, Level and Diameter

Lines = Input(Lines: var[]..[])
DuctType = Input(DuctType: var[]..[])
MechanicalSystemType = Input(MechanicalSystemType: var[]..[])
level = Input(level: var[]..[])
Diameter = Input(Diameter: var[]..[])
python_script = Python(IN[0]=Lines, IN[1]=DuctType, IN[2]=MechanicalSystemType, IN[3]=level, IN[4]=Diameter)
# ---------- python_script.python (90 lines) ----------
import clr

clr.AddReference("RevitServices")
import RevitServices
from RevitServices.Persistence import DocumentManager
from RevitServices.Transactions import TransactionManager
doc = DocumentManager.Instance.CurrentDBDocument

clr.AddReference("RevitAPI")
import Autodesk
from Autodesk.Revit.DB import *

clr.AddReference("RevitNodes")
import Revit
clr.ImportExtensions(Revit.Elements)
clr.ImportExtensions(Revit.GeometryConversion)

toggle = ""

if isinstance(IN[0], list):
	lines = IN[0]
else:
	lines = [IN[0]]
FirstPoint = [x.StartPoint for x in lines]
SecondPoint = [x.EndPoint for x in lines]
ducttype = UnwrapElement(IN[1])
systemtype = UnwrapElement(IN[2])
if isinstance(IN[3], list):
	level = UnwrapElement(IN[3])
	toggle += "0"
else:
	level = [UnwrapElement(IN[3])]
if isinstance(IN[4], list):
	diameter = IN[4]
	toggle += "1"
else:
	diameter = [IN[4]]

elements = []

if toggle == "":
	TransactionManager.Instance.EnsureInTransaction(doc)
	for i,x in enumerate(FirstPoint):
		duct = Autodesk.Revit.DB.Mechanical.Duct.Create(doc,systemtype.Id,ducttype.Id,level[0].Id,FirstPoint[i].ToXyz(),SecondPoint[i].ToXyz())
		
		param = duct.get_Parameter(BuiltInParameter.RBS_CURVE_DIAMETER_PARAM)
		param.SetValueString(diameter[0].ToString())

		elements.append(duct.ToDSType(False))

	TransactionManager.Instance.TransactionTaskDone()
	
elif toggle == "0":
	TransactionManager.Instance.EnsureInTransaction(doc)
	for i,x in enumerate(FirstPoint):
		duct = Autodesk.Revit.DB.Mechanical.Duct.Create(doc,systemtype.Id,ducttype.Id,level[i].Id,FirstPoint[i].ToXyz(),SecondPoint[i].ToXyz())
		
		param = duct.get_Parameter(BuiltInParameter.RBS_CURVE_DIAMETER_PARAM)
		param.SetValueString(diameter[0].ToString())

		elements.append(duct.ToDSType(False))

	TransactionManager.Instance.TransactionTaskDone()
	
elif toggle == "1":
	TransactionManager.Instance.EnsureInTransaction(doc)
	for i,x in enumerate(FirstPoint):
		duct = Autodesk.Revit.DB.Mechanical.Duct.Create(doc,systemtype.Id,ducttype.Id,level[0].Id,FirstPoint[i].ToXyz(),SecondPoint[i].ToXyz())
		
		param = duct.get_Parameter(BuiltInParameter.RBS_CURVE_DIAMETER_PARAM)
		param.SetValueString(diameter[i].ToString())

		elements.append(duct.ToDSType(False))

	TransactionManager.Instance.TransactionTaskDone()
	
elif toggle == "01":
	TransactionManager.Instance.EnsureInTransaction(doc)
	for i,x in enumerate(FirstPoint):
		duct = Autodesk.Revit.DB.Mechanical.Duct.Create(doc,systemtype.Id,ducttype.Id,level[i].Id,FirstPoint[i].ToXyz(),SecondPoint[i].ToXyz())
		
		param = duct.get_Parameter(BuiltInParameter.RBS_CURVE_DIAMETER_PARAM)
		param.SetValueString(diameter[i].ToString())

		elements.append(duct.ToDSType(False))

	TransactionManager.Instance.TransactionTaskDone()


OUT = elements
# ----------------------------------------
Round_Ducts = Output(python_script)
