# Dynamo custom node Element.SystemType.dyf (Dynamo 2.6.1.8786)
# category: MEPover.Revit.Systems
# Returns the mechanical or plumbing System Type

element = Input(element: var[]..[])
python_script = Python(IN[0]=element)
# ---------- python_script.python (69 lines) ----------
import clr

clr.AddReference("RevitServices")
import RevitServices
from RevitServices.Persistence import DocumentManager
from RevitServices.Transactions import TransactionManager
doc = DocumentManager.Instance.CurrentDBDocument

clr.AddReference("RevitAPI")
import Autodesk
from Autodesk.Revit.DB import *

clr.AddReference("RevitNodes")
import Revit
clr.ImportExtensions(Revit.Elements)
clr.ImportExtensions(Revit.GeometryConversion)

#The inputs to this node will be stored as a list in the IN variables.
if isinstance(IN[0],list):
	toggle = 0
	element = UnwrapElement(IN[0])
else:
	toggle = 1
	element = [UnwrapElement(IN[0])]

def getSystem(elem):
	try:
		system = elem.MEPSystem.GetTypeId()
		return doc.GetElement(system)
	except:		
		try:
			connectors = elem.ConnectorManager.Connectors
		except:
			connectors = elem.MEPModel.ConnectorManager.Connectors
		
		if connectors.Size < 2:	
			for conn in connectors:
				connector = conn
				break
			systypeId = connector.MEPSystem.GetTypeId()
			return doc.GetElement(systypeId)
		else:
			systems = []
			ids = set()
			for conn in connectors:
				try:
					if conn.MEPSystem.Id not in ids:
						ids.add(conn.MEPSystem.Id)
						systypeId = conn.MEPSystem.GetTypeId()
						systems.append(doc.GetElement(systypeId))
				except:
					pass
			return systems

listout = []	
for x in element:
	try:
		system = getSystem(x)
		if isinstance(system, list) and len(system) == 1:
			listout.append(system[0])
		else:
			listout.append(system)
	except:
		listout.append(None)
#Assign your output to the OUT variable.
if toggle:
	OUT = system
else:
	OUT = listout
# ----------------------------------------
SystemType = Output(python_script)
