# Dynamo custom node Elements in view by category.dyf (Dynamo 2.6.1.8786)
# category: MEPover.Revit.Elements
# Returns all the elements in the selected view(s) by the selected categor(y)(ies)

view = Input(view: var[]..[])
category = Input(category: var[]..[])
python_script = Python(IN[0]=view, IN[1]=category)
# ---------- python_script.python (40 lines) ----------
import clr
clr.AddReference('RevitAPI')
from Autodesk.Revit.DB import *

clr.AddReference("RevitNodes")
import Revit
clr.ImportExtensions(Revit.Elements)
clr.ImportExtensions(Revit.GeometryConversion)

clr.AddReference("RevitServices")
import RevitServices
from RevitServices.Persistence import DocumentManager

doc = DocumentManager.Instance.CurrentDBDocument
toggle = 0
if isinstance(IN[0], list):
	view = UnwrapElement(IN[0])
else:
	toggle = 1
	view = [UnwrapElement(IN[0])]

if isinstance(IN[1], list):
	category = UnwrapElement(IN[1])
else:
	category = [UnwrapElement(IN[1])]
	
listout = []

for x in view:
	viewlist = []
	for c in category:
		collector = FilteredElementCollector(doc,x.Id)
		elements = collector.OfCategoryId(c.Id).ToElements()
		viewlist.append(elements)
	listout.append(viewlist)

if toggle:
	OUT = viewlist
else:
	OUT = listout
# ----------------------------------------
Elements = Output(python_script)
