# Dynamo custom node PanelScheduleView.NumberOfSlots.dyf (Dynamo 2.6.1.8786)
# category: MEPover.Revit.PanelSchedule
# Returns the number of available slots in a panelschedule

PanelScheduleView = Input(PanelScheduleView: var[]..[])
python_script = Python(IN[0]=PanelScheduleView)
# ---------- python_script.python (35 lines) ----------
import clr

clr.AddReference("RevitServices")
import RevitServices
from RevitServices.Persistence import DocumentManager
from RevitServices.Transactions import TransactionManager
doc = DocumentManager.Instance.CurrentDBDocument

clr.AddReference("RevitAPI")
import Autodesk
from Autodesk.Revit.DB import *

clr.AddReference("RevitNodes")
import Revit
clr.ImportExtensions(Revit.Elements)
clr.ImportExtensions(Revit.GeometryConversion)

#Many thanks to Konrad K Sobon for his awesome ProcessList function!
def Unwrap(item):
	return UnwrapElement(item)

def ProcessList(_func, _list):
    return map( lambda x: ProcessList(_func, x) if type(x)==list else _func(x), _list )

if isinstance(IN[0], list):
	panelschedule = ProcessList(Unwrap, IN[0])
else:
	panelschedule = [Unwrap(IN[0])]
	
	
def GetNumber(panelschedule):
	return panelschedule.GetTableData().NumberOfSlots


OUT = ProcessList(GetNumber, panelschedule)
# ----------------------------------------
Number = Output(python_script)
