# Dynamo custom node Pipe.AddCapOntoOpenEnd.dyf (Dynamo 2.6.1.8786)
# category: MEPover.Revit.Elements
# This node will attempt to add a cap onto an open pipe. The cap type needs to be set in the pipe's routing preferences.

Pipe = Input(Pipe: var[]..[])
python = Python(IN[0]=Pipe)
# ---------- python.python (46 lines) ----------
import clr

clr.AddReference("RevitServices")
import RevitServices
from RevitServices.Persistence import DocumentManager
from RevitServices.Transactions import TransactionManager
doc = DocumentManager.Instance.CurrentDBDocument

clr.AddReference("RevitAPI")
import Autodesk
from Autodesk.Revit.DB import *

clr.AddReference("RevitNodes")
import Revit
clr.ImportExtensions(Revit.Elements)
clr.ImportExtensions(Revit.GeometryConversion)

#Many thanks to Konrad K Sobon for his awesome ProcessList function!
def Unwrap(item):
	return UnwrapElement(item)

def ProcessList(_func, _list):
    return map( lambda x: ProcessList(_func, x) if type(x)==list else _func(x), _list )

if isinstance(IN[0], list):
	pipes = ProcessList(Unwrap, IN[0])
else:
	pipes = [Unwrap(IN[0])]
	
invalidId = ElementId(-1)

def AddPipeCap(pipe):
	result = False
	try:
		TransactionManager.Instance.EnsureInTransaction(doc)
		Plumbing.PlumbingUtils.PlaceCapOnOpenEnds(doc,pipe.Id, invalidId)
		TransactionManager.Instance.TransactionTaskDone()
		result = True
	except:
		pass
	return result

			
#Assign your output to the OUT variable.

OUT = ProcessList(AddPipeCap, pipes)
# ----------------------------------------
Succes = Output(python)  # "Succes:bool"
