# Dynamo custom node PipingSystem all elements in network.dyf (Dynamo 2.6.1.8786)
# category: MEPover.Revit.Systems
# Returns every element in the piping network, inlcuding pipes, fittings etc.

PipingSystem = Input(PipingSystem: var[]..[])
python_pipe_network = Python(IN[0]=PipingSystem)
# ---------- python_pipe_network.python (42 lines) ----------
import clr

clr.AddReference("RevitServices")
import RevitServices
from RevitServices.Persistence import DocumentManager
from RevitServices.Transactions import TransactionManager
doc = DocumentManager.Instance.CurrentDBDocument

clr.AddReference("RevitAPI")
import Autodesk
from Autodesk.Revit.DB import *

clr.AddReference("RevitNodes")
import Revit
clr.ImportExtensions(Revit.Elements)
clr.ImportExtensions(Revit.GeometryConversion)

#Many thanks to Konrad K Sobon for his awesome ProcessList function!
def Unwrap(item):
	return UnwrapElement(item)

def ProcessList(_func, _list):
    return map( lambda x: ProcessList(_func, x) if type(x)==list else _func(x), _list )

if isinstance(IN[0], list):
	systems = ProcessList(Unwrap, IN[0])
else:
	systems = [Unwrap(IN[0])]
	
	
def getNetwork(system):
	network = None
	try:
		network = [x.ToDSType(True) for x in system.PipingNetwork]
	except:
		pass
	return network

			
#Assign your output to the OUT variable.

OUT = ProcessList(getNetwork, systems)
# ----------------------------------------
Elements = Output(python_pipe_network)
