# Dynamo custom node RoomAtPoint.dyf (Dynamo 2.3.0.5885)
# category: MEPover.Revit.RoomsAndSpaces
# Returns the room at the location of the point. Returns null if no room is there

point = Input(point: var[]..[])
Phase = Input(Phase: var[]..[])
Document = Input(_Document: var[]..[] = null)
python_script = Python(IN[0]=point, IN[1]=Phase, IN[2]=Document)
# ---------- python_script.python (37 lines) ----------
import clr

clr.AddReference("RevitServices")
import RevitServices
from RevitServices.Persistence import DocumentManager
from RevitServices.Transactions import TransactionManager
doc = DocumentManager.Instance.CurrentDBDocument

clr.AddReference("RevitAPI")
import Autodesk
from Autodesk.Revit.DB import *

clr.AddReference("RevitNodes")
import Revit
clr.ImportExtensions(Revit.Elements)
clr.ImportExtensions(Revit.GeometryConversion)

if IN[2] != None:
	doc = IN[2]

if isinstance(IN[0], list):
	point = [x.ToXyz() for x in IN[0]]
	toggle = 0
else:
	point = [IN[0].ToXyz()]
	toggle = 1
phase = UnwrapElement(IN[1])

listout = []
for p in point:
	space = doc.GetRoomAtPoint(p,phase)
	listout.append(space)

if toggle:
	OUT = space
else:
	OUT = listout
# ----------------------------------------
Room = Output(python_script)
