# Dynamo custom node SetParameterAsProjectUnits.dyf (Dynamo 2.6.1.8786)
# category: MEPover.Revit.Parameters
# Sets the parameters by project unit inputs, no need to convert to Revit internal units first.

Elements = Input(Elements: var[]..[])
ParameterName = Input(ParameterName: string)
Values = Input(Values: var[]..[])
python_script = Python(IN[0]=Elements, IN[1]=ParameterName, IN[2]=Values)
# ---------- python_script.python (81 lines) ----------
import clr
clr.AddReference('ProtoGeometry')
from Autodesk.DesignScript.Geometry import *
clr.AddReference('RevitAPI')
from Autodesk.Revit.DB import *

clr.AddReference("RevitServices")
import RevitServices
from RevitServices.Persistence import DocumentManager
from RevitServices.Transactions import TransactionManager
doc = DocumentManager.Instance.CurrentDBDocument
#The inputs to this node will be stored as a list in the IN variables.
toggle = 0
if isinstance(IN[0], list):
	element = UnwrapElement(IN[0])
else:
	element = [UnwrapElement(IN[0])]
name = IN[1]
if isinstance(IN[2], list):
	values = IN[2]
	toggle = 1
else:
	values = IN[2]
parameters = []
listout = []


def checkParameter(param):
	for p in param:
		internal = p.Definition
		if internal.BuiltInParameter != BuiltInParameter.INVALID:
			return p
	return param[0]

for e in element:
	param = e.GetParameters(name)
	if len(param) == 0:
		parameters.append(None)
	else:
		p = checkParameter(param)
		parameters.append(p)

if toggle == 1:
	TransactionManager.Instance.EnsureInTransaction(doc)
	for i,p in enumerate(parameters):
		if p is None:
			listout.append(None)
		elif p.StorageType == StorageType.Double:
			ProjectUnits = p.DisplayUnitType
			newval = UnitUtils.ConvertToInternalUnits(values[i],ProjectUnits)
			p.Set(newval)
			listout.append(element[i])
		elif p.StorageType == StorageType.ElementId:
			newval = UnwrapElement(values[i])
			p.Set(newval.Id)
			listout.append(element[i])
		else:
			p.Set(values[i])
			listout.append(element[i])
	TransactionManager.Instance.TransactionTaskDone()
else:
	TransactionManager.Instance.EnsureInTransaction(doc)
	for i,p in enumerate(parameters):
		if p is None:
			listout.append(None)
		elif p.StorageType == StorageType.Double:
			ProjectUnits = p.DisplayUnitType
			newval = UnitUtils.ConvertToInternalUnits(values,ProjectUnits)
			p.Set(newval)
			listout.append(element[i])
		elif p.StorageType == StorageType.ElementId:
			newval = UnwrapElement(values)
			p.Set(newval.Id)
			listout.append(element[i])
		else:
			p.Set(values)
			listout.append(element[i])
	TransactionManager.Instance.TransactionTaskDone()

#Assign your output to the OUT variable.
OUT = listout
# ----------------------------------------
Elements_2 = Output(python_script)  # "Elements"
