# Dynamo custom node SpaceAtPoint.dyf (Dynamo 2.6.1.8786)
# category: MEPover.Revit.RoomsAndSpaces
# Returns the space at the location of the point. Returns null if no space is there

point = Input(point: var[]..[])
Phase = Input(Phase: var[]..[])
python_script = Python(IN[0]=point, IN[1]=Phase)
# ---------- python_script.python (34 lines) ----------
import clr

clr.AddReference("RevitServices")
import RevitServices
from RevitServices.Persistence import DocumentManager
from RevitServices.Transactions import TransactionManager
doc = DocumentManager.Instance.CurrentDBDocument

clr.AddReference("RevitAPI")
import Autodesk
from Autodesk.Revit.DB import *

clr.AddReference("RevitNodes")
import Revit
clr.ImportExtensions(Revit.Elements)
clr.ImportExtensions(Revit.GeometryConversion)

if isinstance(IN[0], list):
	point = [x.ToXyz() for x in IN[0]]
	toggle = 0
else:
	point = [IN[0].ToXyz()]
	toggle = 1
phase = UnwrapElement(IN[1])

listout = []
for p in point:
	space = doc.GetSpaceAtPoint(p,phase)
	listout.append(space)

if toggle:
	OUT = space
else:
	OUT = listout
# ----------------------------------------
Space = Output(python_script)
