# Dynamo custom node SpaceCoordination move to associated room.dyf (Dynamo 2.6.1.8786)
# category: MEPover.Revit.RoomsAndSpaces
# Will move the space to the room with the same space/room number (if a room with the same number exists)

space = Input(space: var[]..[])
LinkDoc = Input(LinkDoc: var[]..[])
python_script = Python(IN[0]=space, IN[1]=LinkDoc)
# ---------- python_script.python (100 lines) ----------
import clr
import math

clr.AddReference("RevitServices")
import RevitServices
from RevitServices.Persistence import DocumentManager
from RevitServices.Transactions import TransactionManager
doc = DocumentManager.Instance.CurrentDBDocument

clr.AddReference("RevitAPI")
import Autodesk
from Autodesk.Revit.DB import *

clr.AddReference("RevitNodes")
import Revit
clr.ImportExtensions(Revit.Elements)
clr.ImportExtensions(Revit.GeometryConversion)

from System.Collections.Generic import List

if isinstance(IN[0],list):
	spaces = UnwrapElement(IN[0])
else:
	spaces = [UnwrapElement(IN[0])]
linkdoc = IN[1]

collector3 = FilteredElementCollector(linkdoc)
rooms = collector3.OfCategory(BuiltInCategory.OST_Rooms).ToElements()

spacedict = {}
for x in spaces:
	spacedict[x.Number] = x

roomdict = {}
for x in rooms:
	if x.Location != None:
		roomdict[x.Number] = x


spacenumbers = [x.Number for x in spaces]
roomnumbers = [x.Number for x in rooms if x.Location != None]
spaceset = set(spacenumbers)
roomset = set(roomnumbers)

replace = spaceset.intersection(roomset)

remains = []
moved = []
newlocations = []

options = CopyPasteOptions()
elementlist = List[ElementId]()
	
TransactionManager.Instance.EnsureInTransaction(doc)
for x in replace:
	space = spacedict[x]
	number = space.Number
	roomnumber = space.get_Parameter(BuiltInParameter.SPACE_ASSOC_ROOM_NUMBER).AsString()
	room = roomdict[x]
	posroom = room.Location.Point
	posspace = space.Location.Point
	
	if number != roomnumber:
		newlocations.append(number)
		if round(space.Level.Elevation) != round(room.Level.Elevation):
		#if room moved to a different level: copy space to that level and delete the old one.
			#copy space to room's level
			elementlist.Add(space.Id)
			OffsetZ = (math.ceil((space.Level.Elevation+0.5)*100)/100) - (math.ceil(room.Level.Elevation*100)/100)*-1
			OffsetX = (posspace.X - posroom.X)*-1
			OffsetY = (posspace.Y - posroom.Y)*-1
			direction = XYZ(OffsetX,OffsetY,OffsetZ)
			trans = Transform.CreateTranslation(direction)
			newspace = ElementTransformUtils.CopyElements(doc,elementlist,doc,trans,options)
			elementlist.Clear()

			#delete space
			doc.Delete(space.Id)
		else:
		#otherwise just move it to the new location on the same level
			newloc = XYZ(posroom.X,posroom.Y,posroom.Z)
			try:
				space.Location.Point = newloc
			except:
				pass
	else:
		if posspace.DistanceTo(posroom) < 10/304.8:
			remains.append(number)
		else:
			OffsetX = (posspace.X - posroom.X)*-1
			OffsetY = (posspace.Y - posroom.Y)*-1
			direction = XYZ(OffsetX,OffsetY,0)
			ElementTransformUtils.MoveElement(doc,space.Id,direction)

			moved.append(number)
			elementlist.Clear()
TransactionManager.Instance.TransactionTaskDone()

#Assign your output to the OUT variable.
OUT = newlocations,moved,remains
# ----------------------------------------
code_block = CodeBlock(x=python_script) { x[0]; }
Moved_to_new_location = Output(code_block)
code_block_2 = CodeBlock(x=python_script) { x[1]; }
Moved_within_confines = Output(code_block_2)
code_block_3 = CodeBlock(x=python_script) { x[2]; }
No_changes = Output(code_block_3)
