# Dynamo custom node Tap.By2MEPCurves.dyf (Dynamo 2.6.1.8786)
# category: MEPover.Revit.Elements
# Create a new TakeoffFitting or Tap by takeoff pipe and through pipe

Branch_MEPCurve = Input(Branch_MEPCurve: var[]..[])
Main_MEPCurve = Input(Main_MEPCurve: var[]..[])
python_script = Python(IN[0]=Branch_MEPCurve, IN[1]=Main_MEPCurve)
# ---------- python_script.python (54 lines) ----------
import clr

clr.AddReference("RevitServices")
import RevitServices
from RevitServices.Persistence import DocumentManager
from RevitServices.Transactions import TransactionManager
doc = DocumentManager.Instance.CurrentDBDocument

clr.AddReference("RevitAPI")
from Autodesk.Revit.DB import *

clr.AddReference("RevitNodes")
import Revit
clr.ImportExtensions(Revit.Elements)
clr.ImportExtensions(Revit.GeometryConversion)

if isinstance(IN[0], list):
	pipe1 = UnwrapElement(IN[0])
else:
	pipe1 = [UnwrapElement(IN[0])]
if isinstance(IN[1], list):
	pipe2 = UnwrapElement(IN[1])
else:
	pipe2 = [UnwrapElement(IN[1])]

def closest_connectors(pipe1, pipe2):
	conn1 = pipe1.ConnectorManager.Connectors
	line = pipe2.Location.Curve
	
	dist = 100000000
	conn = None
	for c in conn1:
		conndist = line.Project(c.Origin).Distance
		if conndist < dist:
			dist = conndist
			conn = c
	return conn

	
fittings = []

for i,x in enumerate(pipe2):
	connector = closest_connectors(pipe1[i],pipe2[i])
	
	TransactionManager.Instance.EnsureInTransaction(doc)
	
	fitting = doc.Create.NewTakeoffFitting(connector,x)
	fittings.append(fitting.ToDSType(False))
		
	TransactionManager.Instance.TransactionTaskDone()

			

OUT = fittings
# ----------------------------------------
Fittings = Output(python_script)
