# Dynamo custom node View.SetCategoryVisibility.dyf (Dynamo 2.6.1.8786)
# category: MEPover.Revit.View
# Will set the category visibility for the view. Does not work if a view template dictates the category visibility

category = Input(category: var[]..[])
view = Input(view: var[]..[])
Boolean = Input(Boolean: var[]..[])
python_script = Python(IN[0]=category, IN[1]=view, IN[2]=Boolean)
# ---------- python_script.python (58 lines) ----------
import clr

clr.AddReference("RevitServices")
import RevitServices
from RevitServices.Persistence import DocumentManager
from RevitServices.Transactions import TransactionManager
doc = DocumentManager.Instance.CurrentDBDocument
uiapp = DocumentManager.Instance.CurrentUIApplication
app = uiapp.Application

clr.AddReference("RevitAPI")
import Autodesk
from Autodesk.Revit.DB import *

clr.AddReference("RevitNodes")
import Revit
clr.ImportExtensions(Revit.Elements)
clr.ImportExtensions(Revit.GeometryConversion)
#The inputs to this node will be stored as a list in the IN variables.
if isinstance(IN[0],list):
	category = UnwrapElement(IN[0])
else:
	category = [UnwrapElement(IN[0])]
if isinstance(IN[1], list):	
	views = UnwrapElement(IN[1])
else:
	views = [UnwrapElement(IN[1])]
if isinstance(IN[2],list):
	bools = IN[2]
else:
	bools = [IN[2]]
	
version = int(app.VersionNumber)

report = []
TransactionManager.Instance.EnsureInTransaction(doc)
if version < 2018:
	for view,bool in zip(views,bools):
		for cat in category:
			try:
				view.SetVisibility(cat,bool)
				error = "Succes"
			except:
				error = "Could not set visibility"
		report.append(error)
else:
	for view,bool in zip(views,bools):
		for cat in category:
			try:
				view.SetCategoryHidden(cat.Id, not bool)
				error = "Succes"
			except:
				error = "Could not set visibility"
		report.append(error)
TransactionManager.Instance.TransactionTaskDone()

#Assign your output to the OUT variable.
OUT = report
# ----------------------------------------
