# Dynamo custom node View.ViewRange relative.dyf (Dynamo 2.6.1.8786)
# category: MEPover.Revit.View
# Returns the 4 view range values relative to the view's level

view = Input(view: var[]..[])
python_script = Python(IN[0]=view)
# ---------- python_script.python (82 lines) ----------
import clr

clr.AddReference("RevitServices")
import RevitServices
from RevitServices.Persistence import DocumentManager
from RevitServices.Transactions import TransactionManager
doc = DocumentManager.Instance.CurrentDBDocument

clr.AddReference("RevitAPI")
import Autodesk
from Autodesk.Revit.DB import *

clr.AddReference("RevitNodes")
import Revit
clr.ImportExtensions(Revit.Elements)
clr.ImportExtensions(Revit.GeometryConversion)
#The inputs to this node will be stored as a list in the IN variables.
if isinstance(IN[0], list):
	views  = UnwrapElement(IN[0])
else:
	views = [UnwrapElement(IN[0])]

def getViewRange(view):
	if view.GetType() == Autodesk.Revit.DB.ViewPlan:
		viewrange = view.GetViewRange()
		try:
			cutId = viewrange.GetLevelId(PlanViewPlane.CutPlane)
			cutlevel = doc.GetElement(cutId)
			cut = viewrange.GetOffset(PlanViewPlane.CutPlane)
		except:
			cut = None
		
		try:
			topId = viewrange.GetLevelId(PlanViewPlane.TopClipPlane)
			toplevel = doc.GetElement(topId)
			topelev = toplevel.Elevation
			top = topelev + viewrange.GetOffset(PlanViewPlane.TopClipPlane)
			top -= cutlevel.Elevation
		except:
			top = None
			
		try:
			bottomId = viewrange.GetLevelId(PlanViewPlane.BottomClipPlane)
			bottomlevel = doc.GetElement(bottomId)
			bottomelev = bottomlevel.Elevation
			bottom = bottomelev + viewrange.GetOffset(PlanViewPlane.BottomClipPlane)
			bottom -= cutlevel.Elevation
		except:
			bottom = None
		
		try:
			depthId = viewrange.GetLevelId(PlanViewPlane.ViewDepthPlane)
			depthlevel = doc.GetElement(depthId)
			depthelev = depthlevel.Elevation
			depth = depthelev + viewrange.GetOffset(PlanViewPlane.ViewDepthPlane)
			depth -= cutlevel.Elevation
		except:
			depth = None

	return depth, bottom,cut,top

depth = []
bottom = []
cut = []
top = []

for view in views:
	try:
		depth.append(getViewRange(view)[0])
		bottom.append(getViewRange(view)[1])
		cut.append(getViewRange(view)[2])
		top.append(getViewRange(view)[3])
	except:
		depth.append(None)
		bottom.append(None)
		cut.append(None)
		top.append(None)
#Assign your output to the OUT variable.
if len(depth) == 1:
	OUT = depth[0], bottom[0], cut[0], top[0]
else:
	OUT = depth, bottom, cut, top
# ----------------------------------------
code_block = CodeBlock(x=python_script) { x[3]; }
Top = Output(code_block)
code_block_2 = CodeBlock(x=python_script) { x[2]; }
CutPlane = Output(code_block_2)
code_block_3 = CodeBlock(x=python_script) { x[1]; }
Bottom = Output(code_block_3)
code_block_4 = CodeBlock(x=python_script) { x[0]; }
ViewDepth = Output(code_block_4)
